# Grasshopper definition DirectionCorrection.gh (Grasshopper 1.0.7)

srf = Surface(<surface referenced from the Rhino model>)
edges = BrepEdges(Brep=srf)  # -> Naked, Interior, NonManifold
join = JoinCurves(Curves=edges.Naked, Preserve=False)
pcen = PolygonCenter(Polyline=join)  # -> flatten(CenterV), CenterE, CenterA
panel = Panel("1")
area = Area(Geometry=srf)  # -> Area, Centroid
evalsrf = EvaluateSurface(Surface=srf, Point=area.Centroid)  # -> Point, Normal, UDirection, VDirection, Frame
panel_2 = Panel(srf)
panel_3 = Panel(pcen.CenterV)
panel_4 = Panel(evalsrf.Normal)
line = LineSDL(Start=area.Centroid, Direction=evalsrf.Normal, Length="-1")
pt = Point(area.Centroid)
line_2 = Line(line)
