# Grasshopper definition Explode.gh (Grasshopper 1.0.7)

number_slider = Slider(0, range=0..100)
pt = ConstructPoint(XCoordinate=number_slider, YCoordinate=number_slider, ZCoordinate=number_slider)
pt_2 = ConstructPoint(XCoordinate=Slider(9, range=0..100), YCoordinate=Slider(7, range=0..100), ZCoordinate=Slider(5, range=0..10))
xy = XYPlane(Origin=pt)
box = Box2Pt(PointA=pt, PointB=pt_2, Plane=xy)
brep = Brep(box)
brep2face = CSharpScript(B=brep)  # -> out, Face_List; inputs B: Brep
# ---------- brep2face: C# ----------
    Rhino.Geometry.Collections.BrepFaceList a;
    a = B.Faces;
    Face_List = a;
# ---------- end brep2face ----------
area = Area(Geometry=brep2face.Face_List)  # -> Area, Centroid
panel = Panel(brep2face.Face_List)
